# Dynamo graph placing adaptive compoent panels to mass.dyn (Dynamo 0.6.3.19262)

number = DoubleInput(5)
applycorrectquadpanelization = Custom[applyCorrectQuadPanelization Based UV dir](Row_Number=number)
number_2 = DoubleInput(1)
add = Addition(number, number_2, lacing=Longest)
partition_list = Slice(arg1=add)
number_3 = DoubleInput(5)
uv_grid = UvGrid(arg1=number_3, arg2=number)
number_4 = DoubleInput(1)
number_5 = DoubleInput(1)
uv_grid_2 = UvGrid(arg1=number_4, arg2=number_5)
select_model_element = ModelElementSelection()  # 1 picked in the model
solid_from_element = ElementSolid(select_model_element, lacing=Longest)
explode = GeometryObjectsFromRoot(solid_from_element, lacing=Longest)
get_surface_domain = SurfaceDomain(explode, lacing=Longest)
map = Map(uv_grid_2, get_surface_domain)
surface_normal = NormalEvaluate(map, explode, lacing=Longest)
python_script_with_variable = Python(surface_normal, explode)  # "Python Script With Variable Number of Inputs"
# ---------- python_script_with_variable.python (29 lines) ----------
# Default imports
import clr
clr.AddReference('RevitAPI')
clr.AddReference('RevitAPIUI')
from Autodesk.Revit.DB import *
import Autodesk
import sys
import clr
path = r'C:\Autodesk\Dynamo\Core'
exec_path = r'C:\Autodesk\Dynamo\Core\dll'
sys.path.append(path)
sys.path.append(exec_path)
clr.AddReference('LibGNet')
from Autodesk.LibG import *

#The input to this node will be stored in the IN0...INX variable(s).
normlist = IN0
faces= IN1
filtered = []



for i in range(len(normlist)):
	if normlist[i][0][2] == 0:
		filtered.append(faces[i])
	

#Assign your output to the OUT variable
OUT = filtered
# ----------------------------------------
get_surface_domain_2 = SurfaceDomain(python_script_with_variable, lacing=Longest)
map_2 = Map(uv_grid, get_surface_domain_2)
evaluate_surface = XyzEvaluate(map_2, python_script_with_variable, lacing=Longest)
map_3 = Map(partition_list, evaluate_surface)
map_4 = Map(applycorrectquadpanelization, map_3)
number_6 = DoubleInput(1)
flatten = FlattenListAmt(map_4, number_6)
select_family_type = FamilyTypeSelector(index=7)
adaptive_component_by_xyzs = AdaptiveComponentByPoints(flatten, select_family_type, lacing=Longest)
first_of_list = First(adaptive_component_by_xyzs)
get_family_parameter = FamilyInstanceParameterSelector(first_of_list)
number_7 = DoubleInput(0.3)
set_element_parameter = FamilyInstanceParameterSetter(adaptive_component_by_xyzs, get_family_parameter, number_7, lacing=Longest)
watch_3d = Watch3D(python_script_with_variable)
