# Dynamo custom node applyCorrectQuadPanelization Based UV dir.dyf (Dynamo 0.6.3.19262)
# category: Misc

number = DoubleInput(1)
seq = Input()
get_from_list = GetFromList(number, seq)
watch = Watch(get_from_list)
watch_2 = Watch(seq)
python_script = Python(get_from_list)
# ---------- python_script.python (24 lines) ----------
# Default imports
import clr
clr.AddReference('RevitAPI')
clr.AddReference('RevitAPIUI')
from Autodesk.Revit.DB import *
import Autodesk
import sys
import clr
path = r'C:\Autodesk\Dynamo\Core'
exec_path = r'C:\Autodesk\Dynamo\Core\dll'
sys.path.append(path)
sys.path.append(exec_path)
clr.AddReference('LibGNet')
from Autodesk.LibG import *

#The input to this node will be stored in the IN variable.
roworcol = IN

if roworcol[0].Z == roworcol[1].Z:
	out = 0
else:
	out = 1
#Assign your output to the OUT variable
OUT = out
# ----------------------------------------
Row_Number = Input()
quads_from_rectangular_grid = Custom[Quads from Rectangular Grid](Row_Number=Row_Number, Point_List=seq)  # Given a grid of points (xyz or uv) create a list of quadrilaterals
reverse = Reverse()
transpose_lists = Transpose(seq)
map = Map(reverse, transpose_lists)
watch_3 = Watch(map)
quads_from_rectangular_grid_2 = Custom[Quads from Rectangular Grid](Row_Number=Row_Number, Point_List=watch_3)
if_ = Conditional(python_script, quads_from_rectangular_grid, quads_from_rectangular_grid_2)
result = Output(if_)
watch_4 = Watch(transpose_lists)
