# Dynamo custom node solarradcomp.dyf (Dynamo 0.6.3.27582)
# category: Analyze.Solar

data = Input()
watch = Watch(data)
string = StringInput("comparing old data: ")
old = Input()
first_of_list = First(old)
to_string = ToString(first_of_list)
string_2 = StringInput("to new data : ")
to_string_2 = ToString(data)
concat_strings = ConcatStrings(s3=string, s4=to_string, string_2, to_string_2)
dynamologger_log = Custom[DynamoLogger.Log()](input=concat_strings)  # Uses the DynamoLogger and FSchemeInterop Utils class to print to the console
greater_than = GreaterThan(first_of_list, data)
perform_all = Begin(expr1=dynamologger_log, expr2=greater_than)
newAmt = Input()
list = NewList(index0=data, index1=newAmt)
if_ = Conditional(perform_all, old, list)
result = Output(if_)
