# Dynamo custom node solarradopt.dyf (Dynamo 0.6.3.27582)
# category: Analyze.Solar

maximum_base_case = Input()  # "maximum(base_case)"
current_parameter_value = Input()
greaterthanequals = GreaterThanEquals(maximum_base_case, current_parameter_value)
file_watcher_object = Input()
reset_file_watcher = FileWatcherReset(file_watcher_object)
family_instance = Input()
parameter = Input()
set_element_parameter = FamilyInstanceParameterSetter(family_instance, parameter, current_parameter_value, lacing=Longest)
transaction = Transaction(set_element_parameter)
number = DoubleInput(4000)
wait_for_change = FileWatcherWait(file_watcher_object, number)
number_2 = DoubleInput(100)
pause = Pause(number_2)
amount_to_increment_by = Input()
add = Addition(amount_to_increment_by, current_parameter_value, lacing=Longest)
accumulated_parameter_values_and_solar_d = Input(accumulated_parameter_values_and_solar_data)
path_to_solar_data = Input()
read_file = FileReader(path_to_solar_data)
extract_solar_radiation_value = ComputeSolarRadiationValue(read_file)
solarradcomp = Custom[solarradcomp](old=accumulated_parameter_values_and_solar_d, data=extract_solar_radiation_value, newAmt=current_parameter_value)
solarradopt = Custom[solarradopt](family_instance=family_instance, parameter=parameter, amount_to_increment_by=amount_to_increment_by, maximum_base_case=maximum_base_case, current_parameter_value=add, accumulated_parameter_values_and_solar_data=solarradcomp, path_to_solar_data=path_to_solar_data, file_watcher_object=file_watcher_object)
perform_all = Begin(expr1=reset_file_watcher, expr2=transaction, expr3=wait_for_change, expr4=pause, expr5=solarradopt.result)
if_ = Conditional(greaterthanequals, perform_all, accumulated_parameter_values_and_solar_d)
python_script = Python()
# ---------- python_script.python (20 lines) ----------
# Default imports
import clr
clr.AddReference('RevitAPI')
clr.AddReference('RevitAPIUI')
from Autodesk.Revit.DB import *
import Autodesk
import sys
import clr
path = r'C:\Autodesk\Dynamo\Core'
exec_path = r'C:\Autodesk\Dynamo\Core\dll'
sys.path.append(path)
sys.path.append(exec_path)
clr.AddReference('LibGNet')
from Autodesk.LibG import *

#The input to this node will be stored in the IN variable.
dataEnteringNode = IN

#Assign your output to the OUT variable
OUT = 0
# ----------------------------------------
