# Dynamo custom node solarradupdate.dyf (Dynamo 0.6.3.27582)
# category: Analyze.Solar

family_instance = Input()
parameter = Input()
number = DoubleInput(1)
result = Input()
get_from_list = GetFromList(number, result)
set_element_parameter = FamilyInstanceParameterSetter(family_instance, parameter, get_from_list, lacing=Longest)
transaction = Transaction(set_element_parameter)
first_of_list = First(result)
perform_all = Begin(expr1=transaction, expr2=first_of_list)
